# Grasshopper definition MobiusHops.gh (Grasshopper 1.0.8)
# plug-ins: RhinoCodePluginGH

definitionview = GetBoolean(
    Toggle(True),
    AtLeast=1,
    AtMost=1,
    FalseValue="False",
    Prompt="Choose definition of the geometry",
    TreeAccess=False,
    TrueValue="True")
u_div = GetInteger(Slider(30, range=1..100), {"30"}, selected=[], AtLeast=1, AtMost=1, Maximum=50, Minimum=1, TreeAccess=False)
v_div = GetInteger(Slider(30, range=1..50), {"30"}, selected=[], AtLeast=1, AtMost=1, Maximum=50, Minimum=1, TreeAccess=False)
twists = GetInteger(
    Slider(6, range=1..10),
    {"6"}, selected=[],
    AtLeast=1,
    AtMost=1,
    Maximum=10,
    Minimum=1,
    Prompt="Number of twists",
    TreeAccess=False)
b_value = GetInteger(Slider(10, range=1..10), {"10"}, selected=[], AtLeast=1, AtMost=1, Maximum=10, Minimum=1, TreeAccess=False)
c_value = GetInteger(Slider(5, range=1..10), {"5"}, selected=[], AtLeast=1, AtMost=1, Maximum=10, Minimum=1, TreeAccess=False)
height = GetInteger(Slider(10, range=1..100), {"10"}, selected=[], AtLeast=1, AtMost=1, Maximum=2147483647, Minimum=1, TreeAccess=False)
fish_value = GetNumber(
    Slider(0.57, range=0..20),
    {"0.57"}, selected=[],
    AtLeast=1,
    AtMost=1,
    Maximum=1.797693135e+308,
    Minimum=0,
    TreeAccess=False)
coral_value = GetNumber(
    Slider(1.97, range=0..10),
    {"1.97"}, selected=[],
    AtLeast=1,
    AtMost=1,
    Maximum=1.797693135e+308,
    Minimum=0,
    TreeAccess=False)
py3 = Python3Script(u_div=u_div, v_div=v_div, twists=twists, b=b_value, c=c_value, height=height, fish=fish_value, coral=coral_value)  # -> out, flat_points, surface, Brep_edges, a, bbox; inputs twists: Int32, b: Int32, c: Int32, height: Int32
# ---------- py3: Python ----------
import Rhino.Geometry as rg
import math
import ghpythonlib.components as ghcomp

u_div = int(u_div)
v_div = int(v_div)

u_min, u_max = 0, 2 * math.pi
v_min, v_max = -1, 1

u_step = (u_max - u_min) / u_div
v_step = (v_max - v_min) / v_div


points = []

for i in range(u_div + 1):
    u = u_min + i * u_step
    row = []  # Start a new row for each 'u'
    for j in range(v_div + 1):
        v = v_min + j * v_step
        
        # Möbius 
        x = (fish + (v / 2) * math.cos(twists * u / 2)) * math.cos(u) * b
        y = (coral + (v / 2) * math.cos(twists * u / 2)) * math.sin(u) * c

        z = (v / 2) * math.sin(twists * u / 2) * height
        

        point = rg.Point3d(x, y, z)
        row.append(point) 
    points.append(row)  

flat_points = [point for row in points for point in row]

surface = rg.NurbsSurface.CreateFromPoints(flat_points, u_div + 1, v_div + 1, 3, 3)

surface_edge = ghcomp.BrepEdges(surface)
Brep_edges = surface_edge[0] # gets only curves as there is a Null item
a = Brep_edges #[1] only one curve

bbox = rg.BoundingBox(flat_points)
# ---------- end py3 ----------
srf = Surface(py3.surface)

# ---- group: discrete
u_div_2 = GetInteger(
    Slider(11, range=1..100),
    {"15"}, selected=[],
    AtLeast=5,
    AtMost=100,
    Maximum=2147483647,
    Minimum=-2147483648,
    TreeAccess=False)
v_div_2 = GetInteger(Slider(43, range=1..50), AtLeast=5, AtMost=50, Maximum=2147483647, Minimum=-2147483648, TreeAccess=False)
mesh_surface = MeshSurface(Surface=srf, UCount=u_div_2, VCount=v_div_2, Overhang=True, Equalize=False)

# ----
weave = Weave(Pattern=definitionview, Stream0=srf, Stream1=mesh_surface, NullGaps=False)

# ---- group: discrete (continued)
medges = MeshEdges(Mesh=weave)  # -> NakedEdges, InteriorEdges, NonManifoldEdges
demesh = DeconstructMesh(Mesh=weave)  # -> Vertices, Faces, Colours, Normals
geo = Geometry(weave)

# ----
geo_2 = Geometry(graft([medges.InteriorEdges, medges.NakedEdges]))
context_bake = ContextBake(GeometryEdges=geo_2)
context_bake_2 = ContextBake(Geometry=geo)
